# Grasshopper definition 3dm_2_nas.gh (Grasshopper 0.9.76)
# plug-ins: Python Interpreter, HDTReference, LunchBox

dpipeline = DynamicGeometryPipeline(
    LayerFilter="feet",
    TypeFilter="Surface",
    NameFilter="*",
    enableFullPath=False,
    GroupByLayer=False,
    GroupByType=False,
    IncludeHidden=True,
    IncludeLocked=True)
number_slider = Slider(2, range=0..10)
quads = QuadPanels(Surface=dpipeline, UDivisions=number_slider, VDivisions=number_slider)  # -> flatten(Panels)

dpipeline_2 = DynamicGeometryPipeline(
    LayerFilter="feet_toes",
    TypeFilter="Surface",
    NameFilter="*",
    enableFullPath=False,
    GroupByLayer=False,
    GroupByType=False,
    IncludeHidden=True,
    IncludeLocked=True)
number_slider_2 = Slider(2, range=0..10)
quads_2 = QuadPanels(Surface=dpipeline_2, UDivisions=number_slider_2, VDivisions=number_slider_2)  # -> flatten(Panels)

input_curves = Curve([<curve referenced from the Rhino model> x271])
crv = Curve(input_curves)

panel = Panel("{2910.46,-90.201,3173.76}")
srf = Surface(<surface referenced from the Rhino model>)
dpipeline_3 = DynamicGeometryPipeline(
    LayerFilter="rbe_ends",
    TypeFilter="Curve",
    NameFilter="*",
    enableFullPath=False,
    GroupByLayer=False,
    GroupByType=False,
    IncludeHidden=True,
    IncludeLocked=True)
pt = Point("{180.0,-30.0,202.0}")
geo = Geometry(dpipeline_3)
edges = BrepEdges(Brep=quads)  # -> Naked, Interior, NonManifold
explode = Explode(Curve=geo, Recursive=True)  # -> Segments, Vertices
quads_3 = QuadPanels(Surface=srf, UDivisions=Slider(17, range=0..20), VDivisions=Slider(30, range=0..30))  # -> flatten(Panels)
join = JoinCurves(Curves=edges.Naked, Preserve=False)
geo_2 = Geometry(flatten(crv))
explode_2 = Explode(Curve=join, Recursive=True)  # -> Segments, Vertices
end = EndPoints(Curve=explode.Segments)  # -> Start, End
geo_3 = Geometry(flatten([quads, quads_2]))
edges_2 = BrepEdges(Brep=quads_3)  # -> Naked, Interior, NonManifold
end_2 = EndPoints(Curve=explode_2.Segments)  # -> simplify(Start), End
edges_3 = BrepEdges(Brep=geo_3)  # -> Naked, Interior, NonManifold
join_2 = JoinCurves(Curves=edges_2.Naked, Preserve=False)
flip = FlipMatrix(Data=end.Start)
join_3 = JoinCurves(Curves=edges_3.Naked, Preserve=False)
explode_3 = Explode(Curve=join_2, Recursive=True)  # -> Segments, Vertices
panel_2 = Panel(geo_2)
explode_4 = Explode(Curve=join_3, Recursive=True)  # -> Segments, Vertices
bang = ExplodeTree(Data=flip)  # -> Branch0, Branch1, Branch2, Branch3, Branch4
panel_3 = Panel(flip)
end_3 = EndPoints(Curve=explode_3.Segments)  # -> simplify(Start), End
end_4 = EndPoints(Curve=explode_4.Segments)  # -> simplify(Start), End
preview = CustomPreview(Geometry=geo_3, Shader=ColourSwatch(SwatchColor=RGB(240, 240, 240)))
python = PythonScript(mp=bang.Branch0, s1=bang.Branch1, s2=bang.Branch2, s3=bang.Branch3, s4=bang.Branch4)  # -> out, rbe, rbe_str; inputs mp: list of Point3d, s1: list of Point3d, s2: list of Point3d, s3: list of Point3d, s4: list of Point3d
# ---------- python: Python ----------
import json

def pt_string(new_pt):
    x = new_pt.X
    y = new_pt.Y
    z = new_pt.Z
    coord = [round(x,3), round(y,3), round(z,3)] 
#    coord = str(round(x,3)) + str(round(y,3)) + str(round(z,3))
    return coord

print(mp[1].X, pt_string(mp[1]) )

rbe = []

for n, i in enumerate(mp):
    unit = [pt_string(i), pt_string(s1[n]),pt_string(s2[n]),pt_string(s3[n]),pt_string(s4[n]) ]
    d = {}
    d["mp"] = pt_string(i)
    d["s1"] = pt_string(s1[n])
    d["s2"] = pt_string(s2[n])
    d["s3"] = pt_string(s3[n])
    d["s4"] = pt_string(s4[n])
    
    rbe.append(d)
    

rbe_str = json.dumps(rbe, sort_keys=True)
rbe_str = str(rbe_str)

print(rbe_str)
# ---------- end python ----------
end_5 = EndPoints(Curve=geo_2)  # -> Start, End
pt_2 = Point(flatten(end.Start))
pt_3 = Point(flatten(end_3.Start))
flip_2 = FlipMatrix(Data=end_4.Start)
flip_3 = FlipMatrix(Data=end_3.Start)
dpipeline_4 = DynamicGeometryPipeline(
    LayerFilter="spc",
    TypeFilter="Point",
    NameFilter="*",
    enableFullPath=False,
    GroupByLayer=False,
    GroupByType=False,
    IncludeHidden=True,
    IncludeLocked=True)
pdecon = Deconstruct(Point=end_5.Start)  # -> XComponent, YComponent, ZComponent
pdecon_2 = Deconstruct(Point=end_5.End)  # -> XComponent, YComponent, ZComponent
merge = Merge(Data1=flip_2, Data2=flip_3)
loads = Point()
python_2 = PythonScript(
    sX=pdecon.XComponent,
    sY=pdecon.YComponent,
    sZ=pdecon.ZComponent,
    eX=pdecon_2.XComponent,
    eY=pdecon_2.YComponent,
    eZ=pdecon_2.ZComponent)  # -> out, a; inputs sX: list, sY: list, sZ: list, eX: list, eY: list, eZ: list
# ---------- python_2: Python ----------
import json
import hashlib

lines = []

#print hashlib.algorithms

def hashbrown(a):
    
    m = hashlib.sha256()
    m.update(str(a) )
    m.digest()
    h = m.hexdigest()[:8]
    
    return h

for c, i in enumerate(sX):
    unit = {}
    unit["i"] = c
    unit["r"] = 1.0
    unit["point1"] = (round(sX[c],3), round(sY[c],3), round(sZ[c],3))
    unit["point2"] = (round(eX[c],3), round(eY[c],3), round(eZ[c],3))
    
#    p1 = str(round(sX[c],3))+ str(round(sY[c],3))+ str(round(sZ[c],3))
#    p2 = str(round(eX[c],3))+ str(round(eY[c],3))+ str(round(eZ[c],3))
#    unit["hash1"] = hashbrown(p1)
#    unit["hash2"] = hashbrown(p2)
    #unit["rad"] = r[c]
    lines.append(unit)

line_str = json.dumps(lines, sort_keys=True)
a = line_str

print(a[:1000])
# ---------- end python_2 ----------
pt_4 = Point(flatten(dpipeline_4))
panel_4 = Panel(flip_2)
panel_5 = Panel(python.rbe_str)
cullpt = CullDuplicates(Points=loads, Tolerance=Slider(0.001, range=0..0.001), CullMode=3)  # -> Points, Indices, Valence
panel_6 = Panel(merge)
bang_2 = ExplodeTree(Data=merge)  # -> Branch0, Branch1, Branch2, Branch3
rbe = Point(pt_2)
pdecon_3 = Deconstruct(Point=cullpt.Points)  # -> XComponent, YComponent, ZComponent
python_3 = PythonScript(
    sX=pdecon.XComponent,
    sY=pdecon.YComponent,
    sZ=pdecon.ZComponent,
    eX=pdecon_2.XComponent,
    eY=pdecon_2.YComponent,
    eZ=pdecon_2.ZComponent)  # -> out, model; inputs sX: list, sY: list, sZ: list, eX: list, eY: list, eZ: list
# ---------- python_3: Python ----------
import json
#import hashlib

from collections import OrderedDict
lines = []
model = []

for c, i in enumerate(sX):
    unit = {}
    
    
    unit["i"] = c
    
    unit["point1"] = (round(sX[c],3), round(sY[c],3), round(sZ[c],3))
    unit["point2"] = (round(eX[c],3), round(eY[c],3), round(eZ[c],3))
    
    start_pt = [ round(sX[c],3), round(sY[c],3), round(sZ[c],3) ]
    end_pt = [ round(eX[c],3), round(eY[c],3), round(eZ[c],3) ]
    model.append([start_pt, end_pt])

    #unit["rad"] = r[c]
    
    lines.append(unit)


line_str = json.dumps(lines, sort_keys=True)

#print(line_str[:500])   
print(model[:10])

a = line_str

model = str(model)
# ---------- end python_3 ----------
pdecon_4 = Deconstruct(Point=pt_4)  # -> XComponent, YComponent, ZComponent
python_4 = PythonScript(a=bang_2.Branch0, b=bang_2.Branch1, c=bang_2.Branch2, d=bang_2.Branch3)  # -> out, panel_str; inputs a: list of Point3d, b: list of Point3d, c: list of Point3d, d: list of Point3d
# ---------- python_4: Python ----------
import hashlib
import json
import pprint


def hashbrown(a):
    
    
    m = hashlib.md5()
    m.update(str(a).encode('utf-8') )
    m.digest()
    h = m.hexdigest()[:8]
#    print(a)
#    print(h)
    
    return h

panels = {}

for n,i in enumerate(a):
    unit = {}
    unit["v0"] = (round(a[n].X,3), round(a[n].Y,3), round(a[n].Z,3)) 
    unit["v1"] = (round(b[n].X,3), round(b[n].Y,3), round(b[n].Z,3))
    unit["v2"] = (round(c[n].X,3), round(c[n].Y,3), round(c[n].Z,3))
    unit["v3"] = (round(d[n].X,3), round(d[n].Y,3), round(d[n].Z,3))
    
    if d[n].Y >1:
        unit["pload"] = 1
    else:
        unit["pload"] = 0
    panels[n] = unit
    
panel_str = json.dumps(panels, sort_keys=True)
panel_str = str(panel_str)

print(panel_str[:1000])
# ---------- end python_4 ----------
python_5 = PythonScript(
    x=pdecon_3.XComponent,
    y=pdecon_3.YComponent,
    z=pdecon_3.ZComponent,
    x1=pdecon_4.XComponent,
    y1=pdecon_4.YComponent,
    z1=pdecon_4.ZComponent)  # -> out, spc, load, sim_pt_str; inputs x: list, y: list, z: list, x1: list, y1: list, z1: list
# ---------- python_5: Python ----------
import json

spc = []
load =[]
for n,i in enumerate(x1):
    unit = ""
    unit = [ 91000000+n, round(x1[n],3),round(y1[n],3), round(z1[n],3) ]
    spc.append(unit)
    
for n,i in enumerate(x):
    unit = ""
    unit = [ 92000000+n, round(x[n],3),round(y[n],3), round(z[n],3)]
    load.append(unit)
    

sim_pt = spc + load

sim_pt_str = json.dumps(sim_pt, sort_keys=True)
sim_pt_str = str(sim_pt_str)
print(sim_pt[:1000])

spc = str(spc)
# ---------- end python_5 ----------
panel_7 = Panel(python_2.out)
panel_8 = Panel(python_3.out)
panel_9 = Panel(python_4.out)
panel_10 = Panel(python_5.spc)
panel_11 = Panel(python_5.sim_pt_str)
spc = Point(flatten(pt_4))
shell_quad = Point(flatten(pt_3))
feet_quad = Point(end_4.Start)

# ---- group: RBE
cullpt_2 = CullDuplicates(Points=flatten(feet_quad), Tolerance=Slider(0.001, range=0..0.001), CullMode=3)  # -> Points, Indices, Valence
cullpt_3 = CullDuplicates(Points=shell_quad, Tolerance=Slider(0.001, range=0..0.001), CullMode=3)  # -> Points, Indices, Valence
pt_5 = Point(graft(cullpt_2.Points))
geo_4 = Geometry(flatten(cullpt_3.Points))
cps = ClosestPoints(Point=graft(pt_5), Cloud=geo_4, Count=Slider(1, range=0..10))  # -> ClosestPoint, CPIndex, Distance
larger = LargerThan(FirstNumber=cps.Distance, SecondNumber=Slider(5, range=0..10))  # -> LargerThan, OrEqualTo
dispatch = Dispatch(List=cps.ClosestPoint, DispatchPattern=larger.LargerThan)  # -> ListA, ListB
ln = Line(StartPoint=pt_5, EndPoint=dispatch.ListB)  # -> flatten(Line)
preview_2 = CustomPreview(Geometry=ln, Shader=ColourSwatch(SwatchColor=RGB(240, 240, 240)))

# ---- group: POINT ALL
pt_6 = Point(flatten([shell_quad, feet_quad, spc]))
pt_7 = Point(flatten(pt_6))

# ----
python_6 = PythonScript()  # -> out, a; disabled
# ---------- python_6: Python ----------
import subprocess

#subprocess.call('cmd')


output = subprocess.call(["python C:\\Users\\damon\\Documents\\GitHub\\lattice-optimization\\test\\test_simulate.py" ]) 

output = subprocess.check_output(["python", path + "cluster.py", data, str(num_clusters)])
# ---------- end python_6 ----------
cullpt_4 = CullDuplicates(Points=pt_7, Tolerance=Slider(0.001, range=0..0.001), CullMode=3)  # -> Points, Indices, Valence
pdecon_5 = Deconstruct(Point=cullpt_4.Points)  # -> XComponent, YComponent, ZComponent
python_7 = PythonScript(x=pdecon_5.XComponent, y=pdecon_5.YComponent, z=pdecon_5.ZComponent)  # -> out, a; inputs x: list, y: list, z: list
# ---------- python_7: Python ----------
a = []
for n,i in enumerate(x):
    unit = ""
    unit = "{},{},{},{}".format(20000000+n, round(x[n],3),round(y[n],3), round(z[n],3) ) 
    a.append(unit)
# ---------- end python_7 ----------
end_6 = EndPoints(Curve=ln)  # -> Start, End

py_curr_dir = PythonScript(in_name="model_T.json")  # -> out, gh_file, gh_dir, out_file
# ---------- py_curr_dir: Python ----------
gh_file = ghenv.Component.OnPingDocument().FilePath

gh_l = len( gh_file.split('\\')[-1] )

gh_dir = gh_file[:-gh_l]
print(gh_file, gh_dir)
out_file = gh_dir + in_name
# ---------- end py_curr_dir ----------
current_dir_files = Panel([py_curr_dir.gh_file, py_curr_dir.gh_dir, py_curr_dir.out_file])

py_curr_dir_2 = PythonScript(in_name="line_ONE.json")  # -> out, gh_file, gh_dir, out_file; same code as py_curr_dir
current_dir_files_2 = Panel([py_curr_dir_2.gh_file, py_curr_dir_2.gh_dir, py_curr_dir_2.out_file])

python_8 = PythonScript(csv=python_7.a)  # -> out, line_str, lookup, coord_list, grid_D; inputs csv: list
# ---------- python_8: Python ----------
import hashlib
import json
a = []
x = []
y = []
z =[]
n = []

#print(hashlib.algorithms)

def hashbrown(a):
    
    m = hashlib.md5()
    m.update(str(a).encode('utf-8') )
    m.digest()
    h = m.hexdigest()[:8]
#    print(a)
#    print(h)
    
    return h
    
data_grid_lookup = {}
grid_D = {}

last = 20000001

def find_grid_hash(point):
    
    x = point[0]
    y = point[1]
    z = point[2]
    id = point[3]
    
    coord = str(round(x,3)) + str(round(y,3)) + str(round(z,3))
    key_H = hashbrown(coord)
    
    grid_D[id] = (x, y, z)
#    print("key", key_H)
    
    data_grid_lookup[key_H] = int(id)
    return key_H, id


lines = []
lookup = []
coord_list = grid_D

for c, i in enumerate(csv):
    unit = i.split(",")
    a.append(unit)
    id = str(unit[0])
    x1 = float(unit[1])
    y1 = float(unit[2])
    z1 = float(unit[3])
    
    p1 = (round(x1,3), round(y1,3), round(z1,3), id)
    
    lu = find_grid_hash(p1)
    
    grid_D[id] = [x1,y1,z1]

lookup = json.dumps(data_grid_lookup, sort_keys=True)
lookup = str(lookup)

coord_list = json.dumps(grid_D, sort_keys=True)
coord_list = str(coord_list)

print("lookup: ", lookup[:1000])
#print("coord list ", coord_list)
# ---------- end python_8 ----------
pdecon_6 = Deconstruct(Point=end_6.Start)  # -> XComponent, YComponent, ZComponent
pdecon_7 = Deconstruct(Point=end_6.End)  # -> XComponent, YComponent, ZComponent
panel_12 = Panel(python_8.coord_list)
panel_13 = Panel(python_8.lookup)
python_9 = PythonScript(
    sX=pdecon_6.XComponent,
    sY=pdecon_6.YComponent,
    sZ=pdecon_6.ZComponent,
    eX=pdecon_7.XComponent,
    eY=pdecon_7.YComponent,
    eZ=pdecon_7.ZComponent)  # -> out, a; inputs sX: list, sY: list, sZ: list, eX: list, eY: list, eZ: list; same code as python_2

python_10 = PythonScript(path=py_curr_dir.out_file, data=python_3.model)  # -> out, a
# ---------- python_10: Python ----------
j = ''

#for i in data:
#    csv = csv + '\n' + i
#
#print(csv)

j = data

with open(path, "w") as text_file:
	text_file.write(j)
# ---------- end python_10 ----------

python_11 = PythonScript(path=py_curr_dir_2.out_file, data=python_2.a)  # -> out, a; same code as python_10

# ---- group: FEET DATA
py_curr_dir_3 = PythonScript(in_name="feet_grid.json")  # -> out, gh_file, gh_dir, out_file; same code as py_curr_dir
current_dir_files_3 = Panel([py_curr_dir_3.gh_file, py_curr_dir_3.gh_dir, py_curr_dir_3.out_file])

# ---- group: EXISTING GRID LOOKUP
py_curr_dir_4 = PythonScript(in_name="existing_grid_lookup.json")  # -> out, gh_file, gh_dir, out_file; same code as py_curr_dir
current_dir_files_4 = Panel([py_curr_dir_4.gh_file, py_curr_dir_4.gh_dir, py_curr_dir_4.out_file])

# ---- group: EXISTING GRID DATA
py_curr_dir_5 = PythonScript(in_name="existing_grid.json")  # -> out, gh_file, gh_dir, out_file; same code as py_curr_dir
current_dir_files_5 = Panel([py_curr_dir_5.gh_file, py_curr_dir_5.gh_dir, py_curr_dir_5.out_file])

# ---- group: FEET DATA
python_12 = PythonScript(path=py_curr_dir_3.out_file, data=python_4.panel_str)  # -> out, a; same code as python_10

# ---- group: RBE
py_curr_dir_6 = PythonScript(in_name="rbe.json")  # -> out, gh_file, gh_dir, out_file; same code as py_curr_dir
current_dir_files_6 = Panel([py_curr_dir_6.gh_file, py_curr_dir_6.gh_dir, py_curr_dir_6.out_file])

# ---- group: SPC LOAD DATA
py_curr_dir_7 = PythonScript(in_name="setup_points.json")  # -> out, gh_file, gh_dir, out_file; same code as py_curr_dir
current_dir_files_7 = Panel([py_curr_dir_7.gh_file, py_curr_dir_7.gh_dir, py_curr_dir_7.out_file])

# ---- group: EXISTING GRID LOOKUP
python_13 = PythonScript(path=py_curr_dir_4.out_file, data=python_8.lookup)  # -> out, a; same code as python_10

# ---- group: EXISTING GRID DATA
python_14 = PythonScript(path=py_curr_dir_5.out_file, data=python_8.coord_list)  # -> out, a; same code as python_10

# ---- group: RBE
python_15 = PythonScript(path=py_curr_dir_6.out_file, data=python_9.a)  # -> out, a; same code as python_10

# ---- group: SPC LOAD DATA
python_16 = PythonScript(path=py_curr_dir_7.out_file, data=python_5.sim_pt_str)  # -> out, a; same code as python_10
